% Simulink data dictionary try__.sldd

ITC_status = enum(DefaultValue="NO_ACKNOWLEDGE", StorageType="uint8")
  SUCCESS = 0
  OCCUPIED = 1
  ARBITRATION_LOST = 2
  NO_ACKNOWLEDGE = 4
  BUS_ERROR = 8
  BUS_NOT_IN_USE = 16

ACCEL_RANGE = Simulink.Parameter(4, StorageClass="ExportedGlobal", DataType="uint8")
DLPF_SETTING = Simulink.Parameter(6, StorageClass="ExportedGlobal", DataType="uint8")
SAMPLE_RATE_DIV = Simulink.Parameter(7, StorageClass="ExportedGlobal", DataType="uint8")
MPU6050_ADDR = "0x68"

accel = Simulink.Bus()
  X: double
  Y: double
  Z: double

Vehicle_Status = enum(StorageType="uint8")
  INVALID = 0
  NORMAL = 4
  LANE_CHANGE_RIGHT = 8
  LANE_CHANGE_LEFT = 16
  NEARBY_CRASH = 32
  CAUTION = 100
  CRASH = 128

GYRO_RANGE = Simulink.Parameter(250, StorageClass="ExportedGlobal", DataType="uint16")
ENABLE_GYRO = Simulink.Parameter(true, StorageClass="ExportedGlobal", DataType="boolean")
THRESHOLD_REST = 0.2
THRESHOLD_LANE_CHANGE = 0.2
TS_WRITTER = 0.2
TS_MODEL = 0.05
TS_CORE = 0.05
TS_MPU = 0.05
TS_PRINT = 0.2
TS_READER = 0.2
THRESHOLD_CAUTION = 0.6
THRESHOLD_CRASHED = 0.8
TS_GPS = 0.05

VSP = Simulink.Bus()
  lat: double
  lng: double
  speed: double
  address: uint16
  status: Enum: Vehicle_Status