% Simulink data dictionary try.sldd

ITC_status = enum(DefaultValue="NO_ACKNOWLEDGE", StorageType="uint8")
  SUCCESS = 0
  OCCUPIED = 1
  ARBITRATION_LOST = 2
  NO_ACKNOWLEDGE = 4
  BUS_ERROR = 8
  BUS_NOT_IN_USE = 16

REST_THRESHOLD = 0.2
ACCEL_RANGE = Simulink.Parameter(4, StorageClass="ExportedGlobal", DataType="uint8")
DLPF_SETTING = Simulink.Parameter(6, StorageClass="ExportedGlobal", DataType="uint8")
ENABLE_GYRO = Simulink.Parameter(false, StorageClass="ExportedGlobal", DataType="boolean")
SAMPLE_RATE_DIV = Simulink.Parameter(7, StorageClass="ExportedGlobal", DataType="uint8")
CORE_TS = 0.2
GPS_TS = 1
MODEL_TS = 0.1
MPU6050_ADDR = "0x68"
MPU_TS = 0.1
READER_TS = 0.5
CRASHED_THRESHOLD = 0.6

accel = Simulink.Bus()
  X: double
  Y: double
  Z: double

Vehicle_Status = enum(StorageType="uint8")
  INVALID = 0
  NORMAL = 8
  NEARBY_CRASH = 32
  CRASH = 128

VSP = Simulink.Bus()
  lat: double
  lng: double
  speed: double
  status: Enum: Vehicle_Status
  address: uint32